# Grasshopper definition APP_KJ.gh (Grasshopper 1.0.7)
# plug-ins: Grasshopper-Tekla Link 2021.1.9

# ---- group: Numbers and post centres
rozstaw_postów = Slider(2200, range=0..2400)
liczba_postów = Slider(7, range=0..16)
series = Series(Start=0, Step=rozstaw_postów, Count=liczba_postów)

# ---- group: Timber attributes
class = Slider(4, range=0..10)
material_catalog = MaterialCatalog(Material="Timber")
part_attributes = PartAttributes(Material=material_catalog, Class=class)

# ---- group: Post dimensions
długość = Slider(133, range=0..300)
szerokość = Slider(192, range=0..300)
wysokość = Slider(2400, range=2400..2401)
evaluate = Evaluate(Expression="x-(1/2)*y", x=series, y=długość)
evaluate_2 = Evaluate(Expression="-(1/2)*y", y=szerokość)

# ---- group: Rails dimensions
odsunięcie_od_osi = Slider(-153, range=-400..300)
a = Slider(124, range=-300..300)
b = Slider(103, range=0..300)
evaluate_3 = Evaluate(Expression="-x-(1/2*y)", x=a, y=szerokość)
evaluate_4 = Evaluate(Expression="x-2*y", x=rozstaw_postów, y=odsunięcie_od_osi)
construct_point = ConstructPoint(XCoordinate=odsunięcie_od_osi, YCoordinate=evaluate_3, ZCoordinate=0)
rectangle = Rectangle(Plane=construct_point, XSize=evaluate_4, YSize=a, Radius=0)  # -> Rectangle, Length
box_rectangle = BoxRectangle(Rectangle=rectangle.Rectangle, Height=b)

# ---- group: Plywood
szerokość_arkusza = Slider(1200, range=600..1200)
szerokość_arkusza_2 = Slider(18, range=17..18)
wysokość_arkusza = Slider(2400, range=2400..2401)
multiplication = Multiplication(A=rozstaw_postów, B=liczba_postów)
series_2 = Series(Start=0, Step=szerokość_arkusza, Count=expr("(x/1200)-2", multiplication))
subtraction = Subtraction(A=evaluate_2, B=a, C=szerokość_arkusza_2)
construct_point_2 = ConstructPoint(XCoordinate=series_2, YCoordinate=subtraction, ZCoordinate=0)
class_2 = Slider(3, range=0..10)
rectangle_2 = Rectangle(Plane=construct_point_2, XSize=szerokość_arkusza, YSize=szerokość_arkusza_2, Radius=0)  # -> Rectangle, Length
material_catalog_2 = MaterialCatalog(Material="Timber_Undefined")
box_rectangle_2 = BoxRectangle(Rectangle=rectangle_2.Rectangle, Height=wysokość_arkusza)
part_attributes_2 = PartAttributes(Material=material_catalog_2, Class=class_2)
item = Item(
    Geometry=box_rectangle_2,
    Attributes=part_attributes_2,
    MeshingCoarse=True,
    MeshingJagged=False,
    MeshingMinimal=False,
    MeshingSmooth=False,
    Remove_when_input_is_empty=False,
    Remove_while_inputs_are_being_modified=False,
    Run_in_background=True,
    Show_internal_lines_in_Tekla=False)

# ----
addition = Addition(A=rozstaw_postów, B=odsunięcie_od_osi)
construct_point_3 = ConstructPoint(XCoordinate=addition, YCoordinate=evaluate_3, ZCoordinate=b)
rectangle_3 = Rectangle(Plane=construct_point_3, XSize=evaluate_4, YSize=a, Radius=0)  # -> Rectangle, Length
box_rectangle_3 = BoxRectangle(Rectangle=rectangle_3.Rectangle, Height=b)

# ---- group: Rails location
unit_x = UnitX(Factor=expr("2*x", rozstaw_postów))
liczba_railsów = Slider(4, range=2..16)
unit_z = UnitZ(Factor=expr("720", construct_point))
linear_array = LinearArray(Geometry=box_rectangle, Direction=unit_x, Count=expr("(x-1)/2", liczba_postów))  # -> Geometry, Transform
linear_array_2 = LinearArray(Geometry=linear_array.Geometry, Direction=unit_z, Count=liczba_railsów)  # -> Geometry, Transform

# ----
linear_array_3 = LinearArray(Geometry=box_rectangle_3, Direction=unit_x, Count=expr("(x-1)/2", liczba_postów))  # -> Geometry, Transform
linear_array_4 = LinearArray(Geometry=linear_array_3.Geometry, Direction=unit_z, Count=liczba_railsów)  # -> Geometry, Transform

item_2 = Item(
    Geometry=box_rectangle_3,
    Attributes=part_attributes,
    MeshingCoarse=True,
    MeshingJagged=False,
    MeshingMinimal=False,
    MeshingSmooth=False,
    Remove_when_input_is_empty=False,
    Remove_while_inputs_are_being_modified=False,
    Run_in_background=True,
    Show_internal_lines_in_Tekla=False)
item_3 = Item(
    Geometry=linear_array.Geometry,
    Attributes=part_attributes,
    MeshingCoarse=False,
    MeshingJagged=False,
    MeshingMinimal=False,
    MeshingSmooth=True,
    Remove_when_input_is_empty=False,
    Remove_while_inputs_are_being_modified=False,
    Run_in_background=True,
    Show_internal_lines_in_Tekla=False)
item_4 = Item(
    Geometry=linear_array_2.Geometry,
    Attributes=part_attributes,
    MeshingCoarse=True,
    MeshingJagged=False,
    MeshingMinimal=False,
    MeshingSmooth=False,
    Remove_when_input_is_empty=False,
    Remove_while_inputs_are_being_modified=False,
    Run_in_background=True,
    Show_internal_lines_in_Tekla=False)
item_5 = Item(
    Geometry=linear_array_4.Geometry,
    Attributes=part_attributes,
    MeshingCoarse=True,
    MeshingJagged=False,
    MeshingMinimal=False,
    MeshingSmooth=False,
    Remove_when_input_is_empty=False,
    Remove_while_inputs_are_being_modified=False,
    Run_in_background=True,
    Show_internal_lines_in_Tekla=False)

# ---- group: Foundation
foundation_depth = Slider(-755, range=-5000..0)
foundation_dims = Slider(556, range=50..1000)
evaluate_5 = Evaluate(Expression="x-(1/2)*y", x=series, y=foundation_dims)
evaluate_6 = Evaluate(Expression="-(1/2)*y", y=foundation_dims)
construct_point_4 = ConstructPoint(XCoordinate=evaluate_5, YCoordinate=evaluate_6, ZCoordinate=foundation_depth)
rectangle_4 = Rectangle(Plane=construct_point_4, XSize=foundation_dims, YSize=foundation_dims, Radius=0)  # -> Rectangle, Length

# ----
integer = Integer(expr("-x-50", foundation_depth))

# ---- group: Post dimensions (continued)
construct_point_5 = ConstructPoint(XCoordinate=evaluate, YCoordinate=evaluate_2, ZCoordinate=foundation_depth)
rectangle_5 = Rectangle(Plane=construct_point_5, XSize=długość, YSize=szerokość, Radius=0)  # -> Rectangle, Length
evaluate_7 = Evaluate(Expression="x-y", x=wysokość, y=foundation_depth)
box_rectangle_4 = BoxRectangle(Rectangle=rectangle_5.Rectangle, Height=evaluate_7)
item_6 = Item(
    Geometry=box_rectangle_4,
    Attributes=part_attributes,
    MeshingCoarse=True,
    MeshingJagged=False,
    MeshingMinimal=False,
    MeshingSmooth=False,
    Remove_when_input_is_empty=False,
    Remove_while_inputs_are_being_modified=False,
    Run_in_background=True,
    Show_internal_lines_in_Tekla=False)

# ---- group: Foundation (continued)
box_rectangle_5 = BoxRectangle(Rectangle=rectangle_4.Rectangle, Height=integer)
item_7 = Item(
    Geometry=box_rectangle_5,
    MeshingCoarse=True,
    MeshingJagged=False,
    MeshingMinimal=False,
    MeshingSmooth=False,
    Remove_when_input_is_empty=False,
    Remove_while_inputs_are_being_modified=False,
    Run_in_background=True,
    Show_internal_lines_in_Tekla=False)

# ----
cut = PartCut(
    Part=item_7,
    CuttingPart=item_6,
    Delete=False,
    Remove_when_input_is_empty=False,
    Remove_while_inputs_are_being_modified=False,
    Run_in_background=True)
