# Grasshopper definition KJ railsy.gh (Grasshopper 1.0.7)
# plug-ins: Grasshopper-Tekla Link 2021.1.9

# ---- group: Numbers and post centres
rozstaw_postów = Slider(2286, range=0..2400)
liczba_postów = Slider(5, range=0..16)
series = Series(Start=0, Step=rozstaw_postów, Count=liczba_postów)
construct_point = ConstructPoint(XCoordinate=series, YCoordinate=0, ZCoordinate=0)

# ---- group: Fundament
foundation_depth = Slider(-943, range=-5000..0)
promień = Slider(300, range=0..300)
cylinder = Cylinder(Base=construct_point, Radius=promień, Length=expr("x-100", foundation_depth))

# ---- group: Post dimensions
długość = Slider(100, range=0..300)
szerokość = Slider(200, range=0..300)
wysokość = Slider(2400, range=-1500..2400)
evaluate = Evaluate(Expression="-(1/2)*y", y=szerokość)
evaluate_2 = Evaluate(Expression="x-(1/2)*y", x=series, y=długość)
construct_point_2 = ConstructPoint(XCoordinate=evaluate_2, YCoordinate=evaluate, ZCoordinate=expr("x-1", foundation_depth))
rectangle = Rectangle(Plane=construct_point_2, XSize=długość, YSize=szerokość, Radius=0)  # -> Rectangle, Length
evaluate_3 = Evaluate(Expression="x-y", x=wysokość, y=foundation_depth)
box_rectangle = BoxRectangle(Rectangle=rectangle.Rectangle, Height=evaluate_3)
item = Item(
    Geometry=box_rectangle,
    MeshingCoarse=True,
    MeshingJagged=False,
    MeshingMinimal=False,
    MeshingSmooth=False,
    Remove_when_input_is_empty=False,
    Remove_while_inputs_are_being_modified=False,
    Run_in_background=True,
    Show_internal_lines_in_Tekla=False)

# ---- group: Railsy
odsunięcie_od_osi = Slider(-100, range=-400..300)
b = Slider(100, range=0..300)
a = Slider(38, range=-300..300)
evaluate_4 = Evaluate(Expression="-x-(1/2*y)", x=a, y=szerokość)
evaluate_5 = Evaluate(Expression="x-2*y", x=rozstaw_postów, y=odsunięcie_od_osi)
construct_point_3 = ConstructPoint(XCoordinate=odsunięcie_od_osi, YCoordinate=evaluate_4, ZCoordinate=0)
rectangle_2 = Rectangle(Plane=construct_point_3, XSize=evaluate_5, YSize=a, Radius=0)  # -> Rectangle, Length
box_rectangle_2 = BoxRectangle(Rectangle=rectangle_2.Rectangle, Height=b)

# ---- group: Plywood
szerokość_arkusza = Slider(1200, range=600..1200)
szerokość_arkusza_2 = Slider(18, range=17..18)
wysokość_arkusza = Slider(2400, range=600..2400)
multiplication = Multiplication(A=rozstaw_postów, B=liczba_postów)
series_2 = Series(Start=0, Step=szerokość_arkusza, Count=expr("(x/1200)-2", multiplication))
subtraction = Subtraction(A=evaluate, B=a, C=szerokość_arkusza_2)
construct_point_4 = ConstructPoint(XCoordinate=series_2, YCoordinate=subtraction, ZCoordinate=0)
rectangle_3 = Rectangle(Plane=construct_point_4, XSize=szerokość_arkusza, YSize=szerokość_arkusza_2, Radius=0)  # -> Rectangle, Length
box_rectangle_3 = BoxRectangle(Rectangle=rectangle_3.Rectangle, Height=wysokość_arkusza)
item_2 = Item(
    Geometry=box_rectangle_3,
    MeshingCoarse=True,
    MeshingJagged=False,
    MeshingMinimal=False,
    MeshingSmooth=False,
    Remove_when_input_is_empty=False,
    Remove_while_inputs_are_being_modified=False,
    Run_in_background=True,
    Show_internal_lines_in_Tekla=False)

# ----
addition = Addition(A=rozstaw_postów, B=odsunięcie_od_osi)
construct_point_5 = ConstructPoint(XCoordinate=addition, YCoordinate=evaluate_4, ZCoordinate=b)
rectangle_4 = Rectangle(Plane=construct_point_5, XSize=evaluate_5, YSize=a, Radius=0)  # -> Rectangle, Length
box_rectangle_4 = BoxRectangle(Rectangle=rectangle_4.Rectangle, Height=b)

part_cut = PartCut(
    Part=cylinder,
    CuttingPart=item,
    Delete=False,
    Remove_when_input_is_empty=False,
    Remove_while_inputs_are_being_modified=False,
    Run_in_background=True)

unit_x = UnitX(Factor=expr("2*x", rozstaw_postów))
liczba_railsów = Slider(4, range=2..16)
unit_z = UnitZ(Factor=expr("720", construct_point_3))
linear_array = LinearArray(Geometry=box_rectangle_2, Direction=unit_x, Count=expr("(x-1)/2", liczba_postów))  # -> Geometry, Transform
linear_array_2 = LinearArray(Geometry=linear_array.Geometry, Direction=unit_z, Count=liczba_railsów)  # -> Geometry, Transform

linear_array_3 = LinearArray(Geometry=box_rectangle_4, Direction=unit_x, Count=expr("(x-1)/2", liczba_postów))  # -> Geometry, Transform
linear_array_4 = LinearArray(Geometry=linear_array_3.Geometry, Direction=unit_z, Count=liczba_railsów)  # -> Geometry, Transform

item_3 = Item(
    Geometry=linear_array_2.Geometry,
    MeshingCoarse=True,
    MeshingJagged=False,
    MeshingMinimal=False,
    MeshingSmooth=False,
    Remove_when_input_is_empty=False,
    Remove_while_inputs_are_being_modified=False,
    Run_in_background=True,
    Show_internal_lines_in_Tekla=False)
item_4 = Item(
    Geometry=linear_array_4.Geometry,
    MeshingCoarse=True,
    MeshingJagged=False,
    MeshingMinimal=False,
    MeshingSmooth=False,
    Remove_when_input_is_empty=False,
    Remove_while_inputs_are_being_modified=False,
    Run_in_background=True,
    Show_internal_lines_in_Tekla=False)
